# Dynamo graph Dynamo Code - Separate Lists.dyn "Team12 - Dynamo Code - Separate Lists-2" (Dynamo 2.10.1.3976)
# packages: Rhythm 2021.7.3, Clockwork for Dynamo 2.x 2.3.0

# group: Calling Door Families and Instances
categories = Categories("OST_Doors")
all_family_types_of_category = Custom[All Family Types Of Category](category=categories)  # package Clockwork for Dynamo 2.x; Gets all family types/symbols of a given category in the model.
string_from_object = FromObject(object=all_family_types_of_category)
code_block = CodeBlock { "T12"; }
contains = String.Contains(str=string_from_object, searchFor=code_block)
filterByBoolMask = List.FilterByBoolMask(list=all_family_types_of_category, mask=contains)
all_elements_of_family_type = Custom[All Elements of Family Type+](familyType=filterByBoolMask.in)  # package Clockwork for Dynamo 2.x; Unlike the built-in node, this node retrieves all placed instances of a given loadable *or* system family type

# group: Calling Wall Families and Instances
categories_2 = Categories("OST_Walls")
all_family_types_of_category_2 = Custom[All Family Types Of Category](category=categories_2)
name = FamilyType.Name(familyType=all_family_types_of_category_2)
code_block_2 = CodeBlock { "T12"; }
contains_2 = String.Contains(str=name, searchFor=code_block_2)
filterByBoolMask_2 = List.FilterByBoolMask(list=all_family_types_of_category_2, mask=contains_2)
all_elements_of_family_type_2 = Custom[All Elements of Family Type+](familyType=filterByBoolMask_2.in)

# group: Calling Pipe Families (Cold Water) and Instances
categories_3 = Categories("OST_PipeCurves")
all_family_types_of_category_3 = Custom[All Family Types Of Category](category=categories_3)
name_2 = FamilyType.Name(familyType=all_family_types_of_category_3)
code_block_3 = CodeBlock { "T12 - Cold"; }
contains_3 = String.Contains(str=name_2, searchFor=code_block_3)
filterByBoolMask_3 = List.FilterByBoolMask(list=all_family_types_of_category_3, mask=contains_3)
all_elements_of_family_type_3 = Custom[All Elements of Family Type+](familyType=filterByBoolMask_3.in)

# group: Calling Pipe Families (Hot Water) and Instances
categories_4 = Categories("OST_PipeCurves")
all_family_types_of_category_4 = Custom[All Family Types Of Category](category=categories_4)
name_3 = FamilyType.Name(familyType=all_family_types_of_category_4)
code_block_4 = CodeBlock { "T12 - Hot"; }
contains_4 = String.Contains(str=name_3, searchFor=code_block_4)
filterByBoolMask_4 = List.FilterByBoolMask(list=all_family_types_of_category_4, mask=contains_4)
all_elements_of_family_type_4 = Custom[All Elements of Family Type+](familyType=filterByBoolMask_4.in)

# group: Calling Pipe Families (Vent) and Instances
categories_5 = Categories("OST_PipeCurves")
all_family_types_of_category_5 = Custom[All Family Types Of Category](category=categories_5)
name_4 = FamilyType.Name(familyType=all_family_types_of_category_5)
code_block_5 = CodeBlock { "T12 - Vent"; }
contains_5 = String.Contains(str=name_4, searchFor=code_block_5)
filterByBoolMask_5 = List.FilterByBoolMask(list=all_family_types_of_category_5, mask=contains_5)
all_elements_of_family_type_5 = Custom[All Elements of Family Type+](familyType=filterByBoolMask_5.in)

# group: Calling Pipe Families (Waste) and Instances
categories_6 = Categories("OST_PipeCurves")
all_family_types_of_category_6 = Custom[All Family Types Of Category](category=categories_6)
name_5 = FamilyType.Name(familyType=all_family_types_of_category_6)
code_block_6 = CodeBlock { "T12 - Waste"; }
contains_6 = String.Contains(str=name_5, searchFor=code_block_6)
filterByBoolMask_6 = List.FilterByBoolMask(list=all_family_types_of_category_6, mask=contains_6)
all_elements_of_family_type_6 = Custom[All Elements of Family Type+](familyType=filterByBoolMask_6.in)

# group: Calling Plumbing Fixtures Families (Sinks) and Instances
categories_7 = Categories("OST_PlumbingFixtures")
all_family_types_of_category_7 = Custom[All Family Types Of Category](category=categories_7)
string_from_object_2 = FromObject(object=all_family_types_of_category_7)
code_block_7 = CodeBlock { "T12 - Sink"; }
contains_7 = String.Contains(str=string_from_object_2, searchFor=code_block_7)
filterByBoolMask_7 = List.FilterByBoolMask(list=all_family_types_of_category_7, mask=contains_7)
all_elements_of_family_type_7 = Custom[All Elements of Family Type+](familyType=filterByBoolMask_7.in)

# group: Calling Plumbing Fixtures Families (WC) and Instances
categories_8 = Categories("OST_PlumbingFixtures")
all_family_types_of_category_8 = Custom[All Family Types Of Category](category=categories_8)
string_from_object_3 = FromObject(object=all_family_types_of_category_8)
code_block_8 = CodeBlock { "T12 - WC"; }
contains_8 = String.Contains(str=string_from_object_3, searchFor=code_block_8)
filterByBoolMask_8 = List.FilterByBoolMask(list=all_family_types_of_category_8, mask=contains_8)
all_elements_of_family_type_8 = Custom[All Elements of Family Type+](familyType=filterByBoolMask_8.in)

# group: Calling Plumbing Fixtures Families (Shower) and Instances
categories_9 = Categories("OST_PlumbingFixtures")
all_family_types_of_category_9 = Custom[All Family Types Of Category](category=categories_9)
string_from_object_4 = FromObject(object=all_family_types_of_category_9)
code_block_9 = CodeBlock { "T12 - Shower"; }
contains_9 = String.Contains(str=string_from_object_4, searchFor=code_block_9)
filterByBoolMask_9 = List.FilterByBoolMask(list=all_family_types_of_category_9, mask=contains_9)
all_elements_of_family_type_9 = Custom[All Elements of Family Type+](familyType=filterByBoolMask_9.in)

# group: Calling Plumbing Fixtures Families (Boiler) and Instances
categories_10 = Categories("OST_PlumbingFixtures")
all_family_types_of_category_10 = Custom[All Family Types Of Category](category=categories_10)
string_from_object_5 = FromObject(object=all_family_types_of_category_10)
code_block_10 = CodeBlock { "T12 - Boiler"; }
contains_10 = String.Contains(str=string_from_object_5, searchFor=code_block_10)
filterByBoolMask_10 = List.FilterByBoolMask(list=all_family_types_of_category_10, mask=contains_10)
all_elements_of_family_type_10 = Custom[All Elements of Family Type+](familyType=filterByBoolMask_10.in)

# group: Create List of Families
list_create = List.Create(item0=filterByBoolMask.in, item1=filterByBoolMask_2.in, item2=filterByBoolMask_3.in, item3=filterByBoolMask_4.in, item4=filterByBoolMask_5.in, item5=filterByBoolMask_6.in, item6=filterByBoolMask_7.in, item7=filterByBoolMask_8.in, item8=filterByBoolMask_9.in, item9=filterByBoolMask_10.in)

# group: Create List of Instances per Family
list_create_2 = List.Create(item0=all_elements_of_family_type, item1=all_elements_of_family_type_2, item2=all_elements_of_family_type_3, item3=all_elements_of_family_type_4, item4=all_elements_of_family_type_5, item5=all_elements_of_family_type_6, item6=all_elements_of_family_type_7, item7=all_elements_of_family_type_8, item8=all_elements_of_family_type_9, item9=all_elements_of_family_type_10)

# group: Getting Value of DAS Parameters from the Revit Model
code_block_11 = CodeBlock()
# ---------- code_block_11.designscript (9 lines) ----------
"T12 - Connection type";
"T12 - Prefabricated";
"T12 - Accessibility";
"T12 - Heavy equipment needed";
"T12 - Material type";
"T12 - Reusability";
"T12 - Recyclability";
"T12 - Secondary finish";
"T12 - Toxicity";
# ----------------------------------------
getParameterValueByName = Element.GetParameterValueByName(element=list_create, parameterName=code_block_11.out0)
getParameterValueByName_2 = Element.GetParameterValueByName(element=list_create, parameterName=code_block_11.out1)
getParameterValueByName_3 = Element.GetParameterValueByName(element=list_create, parameterName=code_block_11.out2)
getParameterValueByName_4 = Element.GetParameterValueByName(element=list_create, parameterName=code_block_11.out3)
getParameterValueByName_5 = Element.GetParameterValueByName(element=list_create, parameterName=code_block_11.out4)
getParameterValueByName_6 = Element.GetParameterValueByName(element=list_create, parameterName=code_block_11.out5)
getParameterValueByName_7 = Element.GetParameterValueByName(element=list_create, parameterName=code_block_11.out6)
getParameterValueByName_8 = Element.GetParameterValueByName(element=list_create, parameterName=code_block_11.out7)
getParameterValueByName_9 = Element.GetParameterValueByName(element=list_create, parameterName=code_block_11.out8)
string = StringInput("T12 - Age")
ʳʰʸᵗʰᵐ_elements = Rhythm.Revit.Elements.Elements.GetParameterValueByNameTypeOrInstance(element=list_create_2, parameterName=string)
string_2 = StringInput("T12 - Condition")
ʳʰʸᵗʰᵐ_elements_2 = Rhythm.Revit.Elements.Elements.GetParameterValueByNameTypeOrInstance(element=list_create_2, parameterName=string_2)
string_3 = StringInput("T12 - Life Expectancy")
ʳʰʸᵗʰᵐ_elements_3 = Rhythm.Revit.Elements.Elements.GetParameterValueByNameTypeOrInstance(element=list_create_2, parameterName=string_3)

# group: D_Score, R_Score & Das Calculation
calculation = Python(IN[0]=getParameterValueByName, IN[1]=getParameterValueByName_2, IN[2]=getParameterValueByName_3, IN[3]=getParameterValueByName_4, IN[4]=getParameterValueByName_5, IN[5]=getParameterValueByName_6, IN[6]=getParameterValueByName_7, IN[7]=getParameterValueByName_8, IN[8]=getParameterValueByName_9, IN[9]=ʳʰʸᵗʰᵐ_elements, IN[10]=ʳʰʸᵗʰᵐ_elements_2, IN[11]=list_create_2, IN[12]=ʳʰʸᵗʰᵐ_elements_3)  # IronPython2
# ---------- calculation.python (295 lines) ----------
# Load the Python Standard and DesignScript Libraries
import sys
import clr
clr.AddReference('ProtoGeometry')
from Autodesk.DesignScript.Geometry import *
import math

# The inputs to this node will be stored as a list in the IN variables.
dataEnteringNode = IN

# Place your code below this line

#IN[11] :List of all instances(Each family has an individual list inside the main list) 
#IN[11]=[[Doors instances],[Walls instances],[Pipes instances],[Plumping Fixtures instances]]

#Connection Type Scoring
Con_type=[]   #Con_type: Connection_Type Score
Con=IN[0]     #Connection_type Inpur
i=0
for Category in IN[11]:
   L2=[]
   j=0
   for family in Category:
      L1=[]
      for instance in family:
         if Con[i][j]=="Nail":
            L1.append(0)
         elif Con[i][j]=="Screw":
            L1.append(1)
         elif Con[i][j]=="Fixed":
            L1.append(0)
         elif Con[i][j]=="Thread":
            L1.append(1)
      j=j+1
      L2.append(L1)
   i=i+1
   Con_type.append(L2)
#Prefabrication Scoring 
#IN[11]=[[Doors instances],[Walls instances],[Pipes instances],[Plumping Fixtures instances]]
#Prefab : Prefabrication Score
Prefab=[]
Tempor=IN[1]
i=0
for Category in IN[11]:
   L2=[]
   j=0
   for family in Category:
      L1=[]
      for instance in family:
         L1.append(Tempor[i][j])
      j=j+1
      L2.append(L1)
   i=i+1
   Prefab.append(L2)

#Accessibility Scoring
#IN[11]=[[Doors instances],[Walls instances],[Pipes instances],[Plumping Fixtures instances]]
#Access: Accessibility Score
Access=[]
Tempor=IN[2]
i=0
for Category in IN[11]:
   L2=[]
   j=0
   for family in Category:
      L1=[]
      for instance in family:
         L1.append(Tempor[i][j])
      j=j+1
      L2.append(L1)
   i=i+1
   Access.append(L2)
   
#Heavy Equipment need for deconstruction Scoring  
#IN[11]=[[Doors instances],[Walls instances],[Pipes instances],[Plumping Fixtures instances]]
#Heavy :Need of heavy equipment score
Heavy=[]
Tempor=IN[3]
i=0
for Category in IN[11]:
   L2=[]
   j=0
   for family in Category:
      L1=[]
      for instance in family:
         L1.append(1-Tempor[i][j])
      j=j+1
      L2.append(L1)
   i=i+1
   Heavy.append(L2)

#Material Scoring     
#IN[11]=[[Doors instances],[Walls instances],[Pipes instances],[Plumping Fixtures instances]]
Material=[]
Tempor=IN[4]
i=0
for Category in IN[11]:
   L2=[]
   j=0
   for family in Category:
      L1=[]
      for instance in family:
         if Tempor[i][j]=="Aluminium":
            L1.append(1)
         elif Tempor[i][j]=="Timber" or Tempor[i][j]=="Wood" or Tempor[i][j]=="Plywood":
            L1.append(0.9)
         elif Tempor[i][j]=="Gypsum":
            L1.append(0.6)
         elif Tempor[i][j]=="Concrete":
            L1.append(0.1)
         elif Tempor[i][j]=="Plastic":
            L1.append(0.4)
         elif Tempor[i][j]=="Metal":
            L1.append(1)
         elif Tempor[i][j]=="Ceramic":
            L1.append(0.2)
      j=j+1
      L2.append(L1)
   i=i+1
   Material.append(L2)
   
#Reuseability Scoring
#IN[11]=[[Doors instances],[Walls instances],[Pipes instances],[Plumping Fixtures instances]]
#Reuse : Reuseability score
Reuse=[]
Tempor=IN[5]
i=0
for Category in IN[11]:
   L2=[]
   j=0
   for family in Category:
      L1=[]
      for instance in family:
         L1.append(Tempor[i][j])
      j=j+1
      L2.append(L1)
   i=i+1
   Reuse.append(L2)
   
#Recycleability Scoring
#IN[11]=[[Doors instances],[Walls instances],[Pipes instances],[Plumping Fixtures instances]]
#Recycleability Score
Recyc=[]
Tempor=IN[6]
i=0
for Category in IN[11]:
   L2=[]
   j=0
   for family in Category:
      L1=[]
      for instance in family:
         L1.append(Tempor[i][j])
      j=j+1
      L2.append(L1)
   i=i+1
   Recyc.append(L2)
   
#Secondry Finish Scoring   
#IN[11]=[[Doors instances],[Walls instances],[Pipes instances],[Plumping Fixtures instances]]
#Score for having secondry finishes
Sec=[]
Tempor=IN[7]
i=0
for Category in IN[11]:
   L2=[]
   j=0
   for family in Category:
      L1=[]
      for instance in family:
         L1.append(1-Tempor[i][j])
      j=j+1
      L2.append(L1)
   i=i+1
   Sec.append(L2)

#Toxicity Scoring
#IN[11]=[[Doors instances],[Walls instances],[Pipes instances],[Plumping Fixtures instances]]
#Toxicity Score
Tox=[]
Tempor=IN[8]
i=0
for Category in IN[11]:
   L2=[]
   j=0
   for family in Category:
      L1=[]
      for instance in family:
         L1.append(1-Tempor[i][j])
      j=j+1
      L2.append(L1)
   i=i+1
   Tox.append(L2)

#Age Scoring    
#IN[11]=[[Doors instances],[Walls instances],[Pipes instances],[Plumping Fixtures instances]]
Age=[]
Tempor=IN[9]
Tempor2=IN[12]
i=j=k=0
for Category in IN[11]:
   L2=[]
   i=0
   for family in Category:
      L1=[]
      j=0
      for instance in family:
         L1.append(1-Tempor[k][i][j]/Tempor2[k][i][j])
         j=j+1
      L2.append(L1)
      i=i+1
   Age.append(L2)
   k=k+1
   
#Condition Scoring 
#IN[11]=[[Doors instances],[Walls instances],[Pipes instances],[Plumping Fixtures instances]]
Condition=[]
Tempor=IN[10]
i=j=k=0
for Category in IN[11]:
   L2=[]
   i=0
   for family in Category:
      L1=[]
      j=0
      for instance in family:
         if Tempor[k][i][j]=="Bad":
            L1.append(0)
         elif Tempor[k][i][j]=="Salvage":
            L1.append(0.5)
         elif Tempor[k][i][j]=="Good":
            L1.append(1)
         j=j+1
      L2.append(L1)
      i=i+1
   Condition.append(L2)
   k=k+1
   
#D_Score Calculation   
#IN[11]=[[Doors instances],[Walls instances],[Pipes instances],[Plumping Fixtures instances]]
D_Score=[]
i=j=k=0
for Category in IN[11]:
   L2=[]
   i=0
   for family in Category:
      L1=[]
      j=0
      for instance in family:
         Sum=round((Con_type[k][i][j]+Prefab[k][i][j]+Access[k][i][j]+Heavy[k][i][j]+Material[k][i][j])/5,2)
         L1.append(Sum)
         j=j+1
      L2.append(L1)
      i=i+1
   D_Score.append(L2)
   k=k+1 

#R_Score Calculation   
#IN[11]=[[Doors instances],[Walls instances],[Pipes instances],[Plumping Fixtures instances]]
R_Score=[]
i=j=k=0
for Category in IN[11]:
   L2=[]
   i=0
   for family in Category:
      L1=[]
      j=0
      for instance in family:
         Sum=round((Reuse[k][i][j]+Recyc[k][i][j]+Sec[k][i][j]+Tox[k][i][j]+Age[k][i][j]+Condition[k][i][j])/6,2)
         L1.append(Sum)
         j=j+1
      L2.append(L1)
      i=i+1
   R_Score.append(L2)
   k=k+1 

#Das Calculation     
#IN[11]=[[Doors instances],[Walls instances],[Pipes instances],[Plumping Fixtures instances]]
Das=[]
i=j=k=0
for Category in IN[11]:
   L2=[]
   i=0
   for family in Category:
      L1=[]
      j=0
      for instance in family:
         Sum=round(0.6*D_Score[k][i][j]+0.4*R_Score[k][i][j],2)
         L1.append(Sum)
         j=j+1
      L2.append(L1)
      i=i+1
   Das.append(L2)
   k=k+1 
# Assign your output to the OUT variable.
OUT = [IN[11],D_Score,R_Score,Das]
# ----------------------------------------

# group: Putting the D-Score, R-Score & DAS into the model for each Instances
code_block_12 = CodeBlock { 0; 1; }
list_of_instances = List.Slice(list=calculation, start=code_block_12.out0, end=code_block_12.out1)
code_block_13 = CodeBlock { "T12 - D-Score"; "T12 - R-Score"; "T12 - DAS"; }
code_block_14 = CodeBlock { 1; 2; }
list_of_d_score = List.Slice(list=calculation, start=code_block_14.out0, end=code_block_14.out1)
ʳʰʸᵗʰᵐ_elements_4 = Rhythm.Revit.Elements.Elements.SetParameterByNameTypeOrInstance(element=list_of_instances, parameterName=code_block_13.out0, value=list_of_d_score)
code_block_15 = CodeBlock { 2; 3; }
list_of_r_score = List.Slice(list=calculation, start=code_block_15.out0, end=code_block_15.out1)
ʳʰʸᵗʰᵐ_elements_5 = Rhythm.Revit.Elements.Elements.SetParameterByNameTypeOrInstance(element=list_of_instances, parameterName=code_block_13.out1, value=list_of_r_score)
code_block_16 = CodeBlock { 3; 4; }
list_of_das = List.Slice(list=calculation, start=code_block_16.out0, end=code_block_16.out1)
ʳʰʸᵗʰᵐ_elements_6 = Rhythm.Revit.Elements.Elements.SetParameterByNameTypeOrInstance(element=list_of_instances, parameterName=code_block_13.out2, value=list_of_das)

watch = Watch(list_create)
watch_2 = Watch(calculation)
watch_3 = Watch(list_create_2)
