# Dynamo graph Dynamo Code.dyn "Team12 - Dynamo Code" (Dynamo 2.10.1.3976)
# packages: Rhythm 2021.7.3, Clockwork for Dynamo 2.x 2.3.0

# group: Putting the D-Score, R-Score & DAS into the model for each instance
code_block = CodeBlock { 0; 1; }
list_of_instances = List.Slice(start=code_block.out0, end=code_block.out1)  # unwired: list
code_block_2 = CodeBlock { "T12 - D-Score"; "T12 - R-Score"; "T12 - DAS"; }
code_block_3 = CodeBlock { 1; 2; }
list_of_d_score = List.Slice(start=code_block_3.out0, end=code_block_3.out1)  # unwired: list
ʳʰʸᵗʰᵐ_elements = Rhythm.Revit.Elements.Elements.SetParameterByNameTypeOrInstance(element=list_of_instances, parameterName=code_block_2.out0, value=list_of_d_score)
code_block_4 = CodeBlock { 2; 3; }
list_of_r_score = List.Slice(start=code_block_4.out0, end=code_block_4.out1)  # unwired: list
ʳʰʸᵗʰᵐ_elements_2 = Rhythm.Revit.Elements.Elements.SetParameterByNameTypeOrInstance(element=list_of_instances, parameterName=code_block_2.out1, value=list_of_r_score)
code_block_5 = CodeBlock { 3; 4; }
list_of_das = List.Slice(start=code_block_5.out0, end=code_block_5.out1)  # unwired: list
ʳʰʸᵗʰᵐ_elements_3 = Rhythm.Revit.Elements.Elements.SetParameterByNameTypeOrInstance(element=list_of_instances, parameterName=code_block_2.out2, value=list_of_das)

# group: Calling Plumbing Fixtures Families and Instances
categories = Categories("OST_PlumbingFixtures")
all_family_types_of_category = Custom[All Family Types Of Category](category=categories)  # package Clockwork for Dynamo 2.x; Gets all family types/symbols of a given category in the model.
familyName = Custom[FamilyType.FamilyName](familyType=all_family_types_of_category)  # package Clockwork for Dynamo 2.x; Returns the *family* name of a given family *type*
code_block_6 = CodeBlock { "T12"; }
contains = String.Contains(str=familyName, searchFor=code_block_6)
filterByBoolMask = List.FilterByBoolMask(list=all_family_types_of_category, mask=contains)
all_elements_of_family_type = Custom[All Elements of Family Type+](familyType=filterByBoolMask.in)  # package Clockwork for Dynamo 2.x; Unlike the built-in node, this node retrieves all placed instances of a given loadable *or* system family type

# group: Calling Pipe Families and Instances
categories_2 = Categories("OST_PipeCurves")
all_family_types_of_category_2 = Custom[All Family Types Of Category](category=categories_2)
name = FamilyType.Name(familyType=all_family_types_of_category_2)
code_block_7 = CodeBlock { "T12"; }
contains_2 = String.Contains(str=name, searchFor=code_block_7)
filterByBoolMask_2 = List.FilterByBoolMask(list=all_family_types_of_category_2, mask=contains_2)
all_elements_of_family_type_2 = Custom[All Elements of Family Type+](familyType=filterByBoolMask_2.in)

# group: Calling Doors Families and Instances
categories_3 = Categories("OST_Doors")
all_family_types_of_category_3 = Custom[All Family Types Of Category](category=categories_3)
string_from_object = FromObject(object=all_family_types_of_category_3)
code_block_8 = CodeBlock { "DAS"; }
contains_3 = String.Contains(str=string_from_object, searchFor=code_block_8)
filterByBoolMask_3 = List.FilterByBoolMask(list=all_family_types_of_category_3, mask=contains_3)
all_elements_of_family_type_3 = Custom[All Elements of Family Type+](familyType=filterByBoolMask_3.in)

categories_4 = Categories("OST_Walls")
all_family_types_of_category_4 = Custom[All Family Types Of Category](category=categories_4)
name_2 = FamilyType.Name(familyType=all_family_types_of_category_4)
code_block_9 = CodeBlock { "DAS"; }
contains_4 = String.Contains(str=name_2, searchFor=code_block_9)
filterByBoolMask_4 = List.FilterByBoolMask(list=all_family_types_of_category_4, mask=contains_4)

# group: Creating List of Families
list_create = List.Create(item0=filterByBoolMask_3.in, item1=filterByBoolMask_4.in)

watch = Watch(list_create)

# group: Calling Wall Families and Instances
categories_5 = Categories("OST_Walls")
all_family_types_of_category_5 = Custom[All Family Types Of Category](category=categories_5)
name_3 = FamilyType.Name(familyType=all_family_types_of_category_5)
code_block_10 = CodeBlock { "T12"; }
contains_5 = String.Contains(str=name_3, searchFor=code_block_10)
filterByBoolMask_5 = List.FilterByBoolMask(list=all_family_types_of_category_5, mask=contains_5)
all_elements_of_family_type_4 = Custom[All Elements of Family Type+](familyType=filterByBoolMask_5.in)

count = List.Count(list=all_elements_of_family_type_3@L2)
all_elements_of_family_type_5 = Custom[All Elements of Family Type+](familyType=filterByBoolMask_4.in)
string = StringInput("Area")
getParameterValueByName = Element.GetParameterValueByName(element=all_elements_of_family_type_5, parameterName=string)
sum = Math.Sum(values=getParameterValueByName)
list_create_2 = List.Create(item0=count, item1=sum)
watch_2 = Watch(list_create_2)
watch_3 = Watch()  # unwired: arg0
watch_4 = Watch(sum)
code_block_11 = CodeBlock {  }
byKeysValues = DesignScript.Builtin.Dictionary.ByKeysValues()  # unwired: keys, values
file_path = Filename("..\..\..\..\..\2nd Term\Research Project\My work\Dynamo\Book1.xlsx")
file_from_path = FileObject(path=file_path)
code_block_12 = CodeBlock { "Sheet1"; "Sheet2"; }
importExcel = Data.ImportExcel(file=file_from_path, sheetName=code_block_12.out0)
code_block_13 = CodeBlock { 0; 1; }
getItemAtIndex = List.GetItemAtIndex(list=importExcel, index=code_block_13.out0)
getItemAtIndex_2 = List.GetItemAtIndex(list=importExcel, index=code_block_13.out1)
byKeysValues_2 = DesignScript.Builtin.Dictionary.ByKeysValues(keys=getItemAtIndex, values=getItemAtIndex_2)

# group: Getting the value of DAS parameters from the Revit Model
code_block_14 = CodeBlock()
# ---------- code_block_14.designscript (8 lines) ----------
"DECONST_Connection_Type";
"DECONST_Moveability";
"DECONST_Prefabrication";
"DECONST_Tools";
"RECOVER_Reusability";
"RECOVER_Secondary_Finishing";
"RECOVER_Toxicity";
"RECOVER_Recyclability";
# ----------------------------------------
getParameterValueByName_2 = Element.GetParameterValueByName(element=list_create, parameterName=code_block_14.out4)
getParameterValueByName_3 = Element.GetParameterValueByName(element=list_create, parameterName=code_block_14.out0)
getParameterValueByName_4 = Element.GetParameterValueByName(element=list_create, parameterName=code_block_14.out1)
getParameterValueByName_5 = Element.GetParameterValueByName(element=list_create, parameterName=code_block_14.out2)
getParameterValueByName_6 = Element.GetParameterValueByName(element=list_create, parameterName=code_block_14.out3)
getParameterValueByName_7 = Element.GetParameterValueByName(element=list_create, parameterName=code_block_14.out5)
getParameterValueByName_8 = Element.GetParameterValueByName(element=list_create, parameterName=code_block_14.out6)
getParameterValueByName_9 = Element.GetParameterValueByName(element=list_create, parameterName=code_block_14.out7)
string_2 = StringInput("T12 - Life Expectancy")
ʳʰʸᵗʰᵐ_elements_4 = Rhythm.Revit.Elements.Elements.GetParameterValueByNameTypeOrInstance(parameterName=string_2)  # unwired: element
string_3 = StringInput("T12 - Age")
ʳʰʸᵗʰᵐ_elements_5 = Rhythm.Revit.Elements.Elements.GetParameterValueByNameTypeOrInstance(parameterName=string_3)  # unwired: element
string_4 = StringInput("T12 - Condition")
ʳʰʸᵗʰᵐ_elements_6 = Rhythm.Revit.Elements.Elements.GetParameterValueByNameTypeOrInstance(parameterName=string_4)  # unwired: element

valueAtKey = DesignScript.Builtin.Dictionary.ValueAtKey(dictionary=byKeysValues_2, key=getParameterValueByName_2)
watch_5 = Watch(valueAtKey)
all_elements_of_category = ElementsOfCategory(Category=categories_3)
watch_6 = Watch(all_elements_of_category)
watch_7 = Watch(getParameterValueByName)
watch_8 = Watch()  # unwired: arg0
valueAtKey_2 = DesignScript.Builtin.Dictionary.ValueAtKey(dictionary=byKeysValues_2, key=getParameterValueByName_3)
importExcel_2 = Data.ImportExcel(file=file_from_path, sheetName=code_block_12.out1)
getItemAtIndex_3 = List.GetItemAtIndex(list=importExcel_2, index=code_block_13.out0)
getItemAtIndex_4 = List.GetItemAtIndex(list=importExcel_2, index=code_block_13.out1)
byKeysValues_3 = DesignScript.Builtin.Dictionary.ByKeysValues(keys=getItemAtIndex_3, values=getItemAtIndex_4)
code_block_15 = CodeBlock(List1=valueAtKey_2, List2=getParameterValueByName_4, List3=getParameterValueByName_5, List4=getParameterValueByName_6, List5=valueAtKey, List6=getParameterValueByName_7, List7=getParameterValueByName_8, List8=getParameterValueByName_9, Dict=byKeysValues_3)
# ---------- code_block_15.designscript (12 lines) ----------
List1;
List2;
List3;
List4;
List5;
List6;
List7;
List8;
Dict;
D_Score=(List1+List2+List3)/3;
R_Score=(List4+List5+List6)/3;
Das=Dict["D_Weight"]*D_Score+Dict["R_Weight"]*R_Score;
# ----------------------------------------
watch_9 = Watch(code_block_15.Das)
name_4 = FamilyType.Name(familyType=filterByBoolMask_4.in)
